vi "GetFileList.gvi"   [LabVIEW NXG 3.0.0]
inputs:
  "client handle": "Client Handle.gtype"
  "BaseURL": string
outputs:
  "client handle out": "Client Handle.gtype"
  "value": string[]
  "error out": error
types:
  "Client Handle.gtype" = u32
uses:
  NI::HTTP::GET.gvi
diagram:
  Format Into String(formatString="%s%s", $BaseURL, "GetFileNames") -> w1
  call "GET.gvi"(client handle=$"client handle", url=w1) -> (client handle out=w2, body=w3, error out=w4)
  $"client handle out" <- w2
  w5 = string[] []  # FileList
  Unflatten From JSON(JSON string=w3, error in (no error)=w4, type and defaults=w5) -> (error out=w6, value=w7)
  $value <- w7
  $"error out" <- w6
