vi "UI_Actuals.gvi"   [LabVIEW NXG 3.0.0]
inputs:
  "Input": "Client Handle.gtype"
  "Base URL": string[]
  "Error": error
outputs:
  "Output": "Client Handle.gtype"
  "Error out": error
  "Debug": string[]
  "Actuals": "ActualValues.gtype"[]
types:
  "Client Handle.gtype" = u32
  "ActualValues.gtype" = cluster{"Time": f64, "Temp": f64, "RH": f64}
uses:
  WebApp::NodeCommunication::GetActualValues.gvi
  WebApp::NodeCommunication::GetDebug.gvi
diagram:
  case ($Error) {
    frame Error, Default {
      w1 = $Input
      w2 = $Error
      w3 = default
      w4 = default
    }
    frame No Error {
      s1 = $Input  # shift register
      s2 = $Error  # shift register
      for {
        w5 = each element of $"Base URL"
        call "GetActualValues.gvi"(client handle=s1, BaseURL=w5, error in=s2) -> (client handle out=w6, ActualValues=w7, error out=w8)
        call "GetDebug.gvi"(client handle=w6, BaseURL=w5, error in=w8) -> (client handle out=w9, Debug=w10, error out=w11)
        Property Node(instance in=w10) -> ("Location"=w12, "Rev"=w13, "PiCoreTemp"=w14, "Error"=w15)
        Property Node(instance in=w15) -> ("code"=w16)
        Format Into String(formatString="%s Rev: %s PiCoreTemp: %.3f DegC Error: %d", w12, w13, w14, w16) -> w17
        append w7 to w3
        append w17 to w4
        next s1 = w9
        next s2 = w11
      }
      w1 = s1
      w2 = s2
    }
  }
  $Debug <- w4
  $Output <- w1
  $"Error out" <- w2
  $Actuals <- w3
