vi "UI_Averaged.gvi"   [LabVIEW NXG 3.0.0]
inputs:
  "Input": "Client Handle.gtype"
  "Error": error
  "Base URL": string[]
outputs:
  "Output": "Client Handle.gtype"
  "Error out": error
  "Graphs 1": cluster{"Element 1": f64[], "Element 2": f64[]}[]
  "Graphs 2": cluster{"Element 1": f64[], "Element 2": f64[]}[]
types:
  "Client Handle.gtype" = u32
uses:
  WebApp::NodeCommunication::GetAveraged.gvi
diagram:
  case ($Error) {
    frame Error, Default {
      w1 = $Input
      w2 = $Error
      w3 = default
    }
    frame No Error {
      s1 = $Input  # shift register
      s2 = $Error  # shift register
      for {
        w4 = each element of $"Base URL"
        call "GetAveraged.gvi"(client handle=s1, BaseURL=w4, Error in=s2) -> (client handle out=w5, AveragedData=w6, error out=w7)
        Property Node(instance in=w6) -> ("Time"=w8, "Temp"=w9, "RH"=w10)
        Build Cluster(w8, w9) -> w11
        Build Cluster(w8, w10) -> w12
        Build Array(w11, w12) -> w13
        concatenate w13 onto w3
        next s1 = w5
        next s2 = w7
      }
      w1 = s1
      w2 = s2
    }
  }
  Delete From Array(inArray=w3, length (1)=2) -> (outArray=w14, deleted=w15)
  $"Graphs 1" <- w14
  $"Graphs 2" <- w15
  $Output <- w1
  $"Error out" <- w2
