vi "UI_Historical.gvi"   [LabVIEW NXG 3.0.0]
inputs:
  "Input": "Client Handle.gtype"
  "Error": error
  "Base URL": string[]
  "Filenames": string[]
outputs:
  "Output": "Client Handle.gtype"
  "Error out": error
  "Graphs": cluster{"Element 1": f64[], "Element 2": f64[]}[]
  "Graphs_2": cluster{"Element 1": f64[], "Element 2": f64[]}[]
types:
  "Client Handle.gtype" = u32
uses:
  WebApp::NodeCommunication::GetFileData.gvi
diagram:
  case ($Error) {
    frame Error, Default {
      w1 = $Input
      w2 = $Error
      w3 = default
      w4 = default
    }
    frame No Error {
      s1 = $Input  # shift register
      for {
        w5 = each element of $"Base URL"
        w6 = each element of $Filenames
        call "GetFileData.gvi"(client handle=s1, BaseURL=w5, FileName=w6, Error in=$Error) -> (client handle out=w9, AveragedData=w10, error out=w11)
        Property Node(instance in=w10) -> ("Time"=w12, "Temp"=w13, "RH"=w14)
        Build Cluster(w12, w13) -> w15
        Build Cluster(w12, w14) -> w16
        Build Array(w15, w16) -> w17
        concatenate w17 onto w7
        append w11 to w8
        next s1 = w9
      }
      Delete From Array(inArray=w7, length (1)=2) -> (outArray=w3, deleted=w4)
      Merge Errors(w8) -> (error out=w2)
      w1 = s1
    }
  }
  $Graphs <- w3
  $Graphs_2 <- w4
  $Output <- w1
  $"Error out" <- w2
