vi "UI_HistoricalMinMax.gvi"   [LabVIEW NXG 3.0.0]
inputs:
  "Input": "Client Handle.gtype"
  "Error": error
  "Base URL": string[]
outputs:
  "Output": "Client Handle.gtype"
  "Error out": error
  "GraphsT": cluster{"Element 1": f64[], "Element 2": f64[]}[]
  "GraphsRH": cluster{"Element 1": f64[], "Element 2": f64[]}[]
  "RH Strings": string[]
  "T strings": string[]
types:
  "Client Handle.gtype" = u32
uses:
  WebApp::NodeCommunication::GetHistoricalMinMax.gvi
diagram:
  case ($Error) {
    frame Error, Default {
      w1 = $Input
      w2 = $Error
      w3 = default
      w4 = default
      w5 = default
      w6 = default
    }
    frame No Error {
      s1 = $Input  # shift register
      s2 = $Error  # shift register
      for {
        w7 = each element of $"Base URL"
        call "GetHistoricalMinMax.gvi"(client handle=s1, BaseURL=w7, Error in=s2) -> (client handle out=w8, HistMinMax=w9, error out=w10)
        Property Node(instance in=w9) -> ("Time"=w11, "Temp Max"=w12, "Temp Min"=w13, "RH Max"=w14, "RH Min"=w15)
        Array Max And Min(array=w12) -> (max index(es)=w16, max value=w17)
        Array Max And Min(array=w13) -> (min index(es)=w18, min value=w19)
        Array Index(array=w11) -> (out0[w16]=w20)
        To Time Stamp(number=w20) -> w21
        Format Date Time String(time format string (%c)="%d %B %y", time stamp=w21) -> (date/time string=w22)
        Array Index(array=w11) -> (out0[w18]=w23)
        To Time Stamp(number=w23) -> w24
        Format Date Time String(time format string (%c)="%d %B %y", time stamp=w24) -> (date/time string=w25)
        Format Into String(formatString="Temperature: Max %.3f at %s - Min %.3f at %s", w17, w22, w19, w25) -> w26
        Array Max And Min(array=w14) -> (max index(es)=w27, max value=w28)
        Array Max And Min(array=w15) -> (min index(es)=w29, min value=w30)
        Array Index(array=w11) -> (out0[w27]=w31)
        To Time Stamp(number=w31) -> w32
        Format Date Time String(time format string (%c)="%d %B %y", time stamp=w32) -> (date/time string=w33)
        Array Index(array=w11) -> (out0[w29]=w34)
        To Time Stamp(number=w34) -> w35
        Format Date Time String(time format string (%c)="%d %B %y", time stamp=w35) -> (date/time string=w36)
        Format Into String(formatString="RH: Max %.3f at %s - Min %.3f at %s", w28, w33, w30, w36) -> w37
        Build Cluster(w11, w12) -> w38
        Build Cluster(w11, w13) -> w39
        Build Array(w38, w39) -> w40
        Build Cluster(w11, w14) -> w41
        Build Cluster(w11, w15) -> w42
        Build Array(w41, w42) -> w43
        concatenate w40 onto w3
        concatenate w43 onto w4
        append w26 to w5
        append w37 to w6
        next s1 = w8
        next s2 = w10
      }
      w1 = s1
      w2 = s2
    }
  }
  $"T strings" <- w5
  $"RH Strings" <- w6
  $GraphsT <- w3
  $GraphsRH <- w4
  $Output <- w1
  $"Error out" <- w2
